# Grasshopper definition agents_simulator_grasshopperfile.gh (Grasshopper 1.0.8)
# plug-ins: RhinoCodePluginGH

# Boundary surface (closed curve square)
crv = Curve(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)
# Surface generation
number_slider = Slider(20, range=0..100)
py3 = Python3Script(
    Crv=crv,
    U=number_slider,
    V=number_slider,
    Amp=Slider(40, range=0..1000),
    Scale=Slider(3, range=0..100),
    H=Slider(34, range=0..100),
    Seed=Slider(420, range=0..1000))  # -> out, a, b; inputs Crv: Curve, U: Int32, V: Int32, Amp: Double, Scale: Double, H: Double, Seed: Int32
# ---------- py3: Python ----------
import Rhino.Geometry as rg
import numpy as np
import random

# ------------------------------------------------------------
# Inputs:
# Crv : closed planar curve
# U, V : grid resolution
# Amp : amplitude of heightmap
# Scale : perlin noise frequency
# H : Z-offset (height shift)
# Seed : random seed
# ------------------------------------------------------------

if Crv is None:
    a = None
    b = []
else:
    random.seed(Seed)
    np.random.seed(Seed)

    # --------------------------------------------------------
    # PERLIN NOISE (NumPy version)
    # --------------------------------------------------------

    def fade(t):
        return t * t * t * (t * (t * 6 - 15) + 10)

    def lerp(a, b, t):
        return a + t * (b - a)

    perm = np.arange(256)
    np.random.shuffle(perm)
    perm = np.tile(perm, 2)

    def perlin(x, y):
        xi = (x.astype(int) & 255)
        yi = (y.astype(int) & 255)

        xf = x - x.astype(int)
        yf = y - y.astype(int)

        u = fade(xf)
        v = fade(yf)

        aa = perm[perm[xi]     + yi]
        ab = perm[perm[xi]     + yi + 1]
        ba = perm[perm[xi + 1] + yi]
        bb = perm[perm[xi + 1] + yi + 1]

        def grad(h, x, y):
            h = h & 3
            return np.where(
                h == 0, x + y,
                np.where(
                    h == 1, -x + y,
                    np.where(
                        h == 2, x - y,
                        -x - y
                    )
                )
            )

        x1 = lerp(grad(aa, xf,   yf),     grad(ba, xf - 1, yf),       u)
        x2 = lerp(grad(ab, xf,   yf - 1), grad(bb, xf - 1, yf - 1),   u)

        return lerp(x1, x2, v)

    # --------------------------------------------------------
    # BUILD UV GRID INSIDE CRV BOUNDING BOX
    # --------------------------------------------------------

    bbox = Crv.GetBoundingBox(True)
    x0, x1 = bbox.Min.X, bbox.Max.X
    y0, y1 = bbox.Min.Y, bbox.Max.Y

    xs = np.linspace(x0, x1, U + 1)
    ys = np.linspace(y0, y1, V + 1)
    XX, YY = np.meshgrid(xs, ys)

    flat_pts = np.stack([XX, YY], axis = -1).reshape((-1, 2))
    inside_mask = []

    pts2d = []
    for (x, y) in flat_pts:
        test_pt = rg.Point3d(x, y, 0)
        inside = (Crv.Contains(test_pt, rg.Plane.WorldXY, 1e-6) == rg.PointContainment.Inside)
        inside_mask.append(inside)
        pts2d.append(test_pt)

    pts2d = np.array([[p.X, p.Y] for p in pts2d]).reshape((V + 1, U + 1, 2))
    inside_mask = np.array(inside_mask).reshape((V + 1, U + 1))

    # --------------------------------------------------------
    # SOFT EDGE FALLOFF
    # --------------------------------------------------------
    distances = np.zeros((V + 1, U + 1))

    for j in range(V + 1):
        for i in range(U + 1):
            x = pts2d[j, i, 0]
            y = pts2d[j, i, 1]
            test_pt = rg.Point3d(x, y, 0)

            t = Crv.ClosestPoint(test_pt)[1]
            cp = Crv.PointAt(t)
            distances[j, i] = test_pt.DistanceTo(cp)

    max_d = np.max(distances)
    if max_d == 0:
        max_d = 1.0

    falloff = distances / max_d
    falloff = 0.3 + 0.7 * (falloff ** 2)

    # --------------------------------------------------------
    # APPLY PERLIN HEIGHTMAP
    # --------------------------------------------------------

    Uu, Vv = np.meshgrid(np.linspace(0, 1, U + 1), np.linspace(0, 1, V + 1))
    noise = perlin(Uu * Scale, Vv * Scale)

    # Apply Z-offset (H)
    Z = H + noise * Amp * falloff

    # --------------------------------------------------------
    # CREATE 3D POINTS
    # --------------------------------------------------------
    Pts = []
    for j in range(V + 1):
        for i in range(U + 1):
            x = pts2d[j, i, 0]
            y = pts2d[j, i, 1]
            z = Z[j, i]
            Pts.append(rg.Point3d(x, y, z))

    # --------------------------------------------------------
    # CREATE NURBS SURFACE
    # --------------------------------------------------------
    Srf = rg.NurbsSurface.CreateFromPoints(Pts, U + 1, V + 1, 3, 3)

    # --------------------------------------------------------
    # Outputs
    # --------------------------------------------------------
    a = Srf
    b = Pts
# ---------- end py3 ----------
pt = Point(py3.b)
srf = Surface(py3.a)
trigger = Trigger(Interval=50, TimerInterval=50, Target=py3_3)
py3_2 = Python3Script(Srf=py3.a, Pts=pt, Ucnt=number_slider, Vcnt=number_slider, Reset=Button())  # -> out, Agents, AgentPts; inputs Srf: Surface, Pts: list of Point3d, Reset: Boolean
# ---------- py3_2: Python ----------
import Rhino.Geometry as rg

# ------------------------------------------------------------
# Agent class
# ------------------------------------------------------------

class Agent(object):
    def __init__(self, u, v, surface, i, j, idx):
        # param space
        self.u = u
        self.v = v
        self.u0 = u  # home UV
        self.v0 = v

        # grid indices
        self.i = i   # col index
        self.j = j   # row index

        # bookkeeping
        self.idx = idx
        self.is_active = True
        self.still_steps = 0

        # 3D position
        self.pos = surface.PointAt(u, v)

    def update_position(self, surface):
        self.pos = surface.PointAt(self.u, self.v)


# ------------------------------------------------------------
# Build agents from input points + grid size
# ------------------------------------------------------------

def init_agents(surface, pts, u_count, v_count):
    agents = []
    agent_pts = []

    if surface is None or pts is None:
        return [], []

    # make sure we work with a Surface
    if hasattr(surface, "ToNurbsSurface"):
        surface = surface.ToNurbsSurface()

    total = len(pts)
    expected = u_count * v_count

    if total != expected:
        # you can print a warning if you want:
        # print("Warning: len(Pts) != Ucnt*Vcnt ({} vs {})".format(total, expected))
        pass

    for idx, p in enumerate(pts):
        # robust Point3d conversion
        if isinstance(p, rg.Point3d):
            pt = p
        else:
            pt = rg.Point3d(p[0], p[1], p[2])

        # find UV on surface
        res = surface.ClosestPoint(pt)
        if res is None:
            continue

        success, u, v = res
        if not success:
            continue

        # compute grid indices from idx
        i = idx % u_count   # column
        j = idx // u_count  # row

        ag = Agent(u, v, surface, i, j, idx)
        agents.append(ag)
        agent_pts.append(ag.pos)

    return agents, agent_pts


# ------------------------------------------------------------
# Grasshopper execution
# ------------------------------------------------------------

if Srf is None or Pts is None or Ucnt is None or Vcnt is None:
    Agents = []
    AgentPts = []
else:
    Agents, AgentPts = init_agents(Srf, Pts, Ucnt, Vcnt)
# ---------- end py3_2 ----------
py3_3 = Python3Script(
    Srf=srf,
    AgentsIn=py3_2.Agents,
    Reset=Toggle(False),
    Steps=Slider(1, range=0..1),
    MaxSteps=Slider(75, range=0..1000),
    BaseStep=Slider(3, range=0..10),
    CurvWeight=Slider(5, range=0..20),
    CurvScale=Slider(0.3, range=0..20),
    NeighborRadius=Slider(1, range=0..100),
    NeighborWeight=Slider(0.6, range=0..1),
    SlopeInf=Slider(0.2, range=0..1),
    SlopeMode=Slider(-1, range=-1..1),
    StillSteps=Slider(15, range=0..100),
    MinSpacing=Slider(3.5, range=0..100),
    HomeWeight=Slider(0.05, range=0..10))  # -> out, AgentsOut, AgentPts, Dbg; inputs Srf: Surface, AgentsIn: list, Reset: Boolean, Steps: Int32, MaxSteps: Int32, BaseStep: Double, CurvWeight: Double, CurvScale: Double, NeighborRadius: Double, NeighborWeight: Double, SlopeInf: Double, SlopeMode: Int32, StillSteps: Int32, MinSpacing: Double, HomeWeight: Double
# ---------- py3_3: Python ----------
import Rhino.Geometry as rg
import scriptcontext as sc

# ------------------------------------------------------------
# Curvature + principal direction sampling (RhinoCommon)
# ------------------------------------------------------------

def sample_curvature_and_direction(surface, u, v):
    """
    Returns:
        curv_mag : float      (max of |k0|, |k1|)
        dir_vec  : Vector3d   (principal direction of max curvature, unit)
    """
    scurv = surface.CurvatureAt(u, v)
    if scurv is None:
        return 0.0, rg.Vector3d(0, 0, 0)

    try:
        k0 = abs(scurv.Kappa(0))
        k1 = abs(scurv.Kappa(1))
    except:
        k0 = 0.0
        k1 = 0.0

    curv_mag = max(k0, k1)

    dir0 = scurv.Direction(0)
    dir1 = scurv.Direction(1)

    if k0 >= k1:
        dir_vec = dir0
    else:
        dir_vec = dir1

    if dir_vec is None or (not dir_vec.IsValid) or dir_vec.Length <= 1e-9:
        dir_vec = rg.Vector3d(0, 0, 0)
    else:
        dir_vec.Unitize()

    return curv_mag, dir_vec


# ------------------------------------------------------------
# Slope sampling (uphill direction on a heightmap-like surface)
# ------------------------------------------------------------

def sample_slope_direction(surface, u, v):
    """
    Approximate local uphill direction on the surface:
    - assumes Z encodes 'height'
    - returns a 3D unit vector tangent to the surface
    """
    dom_u = surface.Domain(0)
    dom_v = surface.Domain(1)
    du = 0.01 * (dom_u.T1 - dom_u.T0)
    dv = 0.01 * (dom_v.T1 - dom_v.T0)

    # center point
    p = surface.PointAt(u, v)

    # small steps in param space
    u1 = min(dom_u.T1, max(dom_u.T0, u + du))
    v1 = min(dom_v.T1, max(dom_v.T0, v + dv))

    pu = surface.PointAt(u1, v)   # step in u
    pv = surface.PointAt(u, v1)   # step in v

    # tangent vectors
    tu = pu - p
    tv = pv - p

    # Z-change along each tangent direction
    dz_du = pu.Z - p.Z
    dz_dv = pv.Z - p.Z

    # uphill vector in tangent basis
    uphill = rg.Vector3d(
        tu.X * dz_du + tv.X * dz_dv,
        tu.Y * dz_du + tv.Y * dz_dv,
        tu.Z * dz_du + tv.Z * dz_dv
    )

    if uphill.Length <= 1e-9:
        return rg.Vector3d(0, 0, 0)

    uphill.Unitize()
    return uphill   # downhill = -uphill


# ------------------------------------------------------------
# Helper: minimum neighbor distance
# ------------------------------------------------------------

def min_neighbor_distance(agent, agents):
    d_min = float("inf")
    for other in agents:
        if other is agent:
            continue
        d = agent.pos.DistanceTo(other.pos)
        if d < d_min:
            d_min = d
    if d_min == float("inf"):
        d_min = 1e9
    return d_min


# ------------------------------------------------------------
# One simulation step for a single agent
# ------------------------------------------------------------

def step_agent(agent, surface, agents,
               base_step, curv_weight, curv_scale,
               neigh_radius, neigh_weight,
               still_steps_limit, min_spacing,
               home_weight,
               slope_inf, slope_mode):

    # init dynamic attributes if not present
    if not hasattr(agent, "still_steps"):
        agent.still_steps = 0
    if not hasattr(agent, "is_active"):
        agent.is_active = True

    if not agent.is_active:
        return

    # --- sense curvature + direction ---
    curv_mag, curv_dir = sample_curvature_and_direction(surface, agent.u, agent.v)
    if curv_dir.Length == 0.0:
        agent.is_active = False
        return

    if curv_scale is None or curv_scale <= 1e-9:
        curv_scale = 1.0

    # slower in high curvature if curv_weight > 0
    t = min(curv_mag / curv_scale, 1.0)
    speed_factor = 1.0 - curv_weight * t
    step_len = base_step * max(speed_factor, 0.0)

    # --- blend curvature direction with slope direction ---
    # slope_inf in [0,1], slope_mode in [-1,0,1] (or between)
    slope_inf = max(0.0, min(1.0, slope_inf))
    # we don't hard clamp slope_mode, but you can if you want:
    # slope_mode = max(-1.0, min(1.0, slope_mode))

    final_dir = curv_dir

    if abs(slope_mode) > 1e-6 and slope_inf > 1e-6:
        uphill = sample_slope_direction(surface, agent.u, agent.v)
        if uphill.Length > 0.0:
            # downhill if slope_mode < 0, uphill if slope_mode > 0
            slope_dir = uphill * slope_mode
            # blend directions: (1 - slope_inf)*curv_dir + slope_inf*slope_dir
            blended = rg.Vector3d(
                curv_dir.X * (1.0 - slope_inf) + slope_dir.X * slope_inf,
                curv_dir.Y * (1.0 - slope_inf) + slope_dir.Y * slope_inf,
                curv_dir.Z * (1.0 - slope_inf) + slope_dir.Z * slope_inf
            )
            if blended.Length > 1e-9:
                blended.Unitize()
                final_dir = blended

    # base movement from direction field (curvature + optional slope)
    move_vec = final_dir * step_len

    # --- neighbor repulsion for spacing ---
    if neigh_weight > 0.0 and neigh_radius > 0.0:
        rep_vec = rg.Vector3d(0, 0, 0)
        count = 0

        for other in agents:
            if other is agent:
                continue

            d = agent.pos.DistanceTo(other.pos)
            if d < neigh_radius and d > 1e-6:
                v = agent.pos - other.pos
                v.Unitize()
                strength = 1.0 - (d / neigh_radius)
                rep_vec += v * strength
                count += 1

        if count > 0:
            rep_vec /= count
            rep_vec *= (neigh_weight * base_step)
            move_vec += rep_vec

    # --- home spring: softly pull back toward original grid position ---
    if home_weight > 0.0 and hasattr(agent, "u0") and hasattr(agent, "v0"):
        home_pt = surface.PointAt(agent.u0, agent.v0)
        spring_vec = home_pt - agent.pos
        spring_vec *= home_weight   # scale the pull
        move_vec += spring_vec

    # --- spacing check: nearest neighbor distance ---
    d_min = min_neighbor_distance(agent, agents)

    # convergence: good spacing for several steps in a row
    if d_min >= min_spacing:
        agent.still_steps += 1
    else:
        agent.still_steps = 0

    if agent.still_steps >= still_steps_limit:
        agent.is_active = False
        return

    # --- move in 3D, project back to surface ---
    new_pt = agent.pos + move_vec
    ok, u_new, v_new = surface.ClosestPoint(new_pt)
    if not ok:
        agent.is_active = False
        return

    agent.u = u_new
    agent.v = v_new

    if hasattr(agent, "update_position"):
        agent.update_position(surface)
    else:
        agent.pos = surface.PointAt(agent.u, agent.v)


# ------------------------------------------------------------
# Grasshopper execution
# ------------------------------------------------------------

AgentsOut = []
AgentPts = []
Dbg = ""
Done = False

if Srf is None or AgentsIn is None:
    Dbg = "No surface or agents."
else:
    # defaults
    if Steps is None:           Steps = 1
    if MaxSteps is None:        MaxSteps = 100
    if BaseStep is None:        BaseStep = 0.1
    if CurvWeight is None:      CurvWeight = 0.5
    if CurvScale is None:       CurvScale = 1.0
    if NeighborRadius is None:  NeighborRadius = 0.0
    if NeighborWeight is None:  NeighborWeight = 0.0
    if StillSteps is None:      StillSteps = 5
    if MinSpacing is None:      MinSpacing = 0.5
    if HomeWeight is None:      HomeWeight = 0.2   # gentle tether
    if SlopeInf is None:        SlopeInf = 0.0     # no slope by default
    if SlopeMode is None:       SlopeMode = 0.0    # off by default

    key = "agents_state"
    step_key = "agents_total_steps"
    done_key = "agents_done"

    state_missing = (key not in sc.sticky) or (step_key not in sc.sticky) or (done_key not in sc.sticky)

    # --- reset or continue global state ---
    if Reset or state_missing:
        agents = list(AgentsIn)   # fresh from builder
        total_steps = 0
        done_flag = False
    else:
        agents = sc.sticky[key]
        total_steps = sc.sticky[step_key]
        done_flag = sc.sticky[done_key]

    # --- run simulation only if under global MaxSteps, not resetting, and not already done ---
    if (not Reset) and (not done_flag) and (total_steps < MaxSteps):
        for _ in range(Steps):
            if total_steps >= MaxSteps or done_flag:
                break

            # one global step: update all agents
            for ag in agents:
                step_agent(ag, Srf, agents,
                           BaseStep, CurvWeight, CurvScale,
                           NeighborRadius, NeighborWeight,
                           StillSteps, MinSpacing,
                           HomeWeight,
                           SlopeInf, SlopeMode)
            total_steps += 1

            # check how many are still active
            active_count_step = sum(1 for a in agents if getattr(a, "is_active", True))
            if active_count_step == 0:
                done_flag = True
                break
    else:
        active_count_step = sum(1 for a in agents if getattr(a, "is_active", True))

    # store updated state
    sc.sticky[key] = agents
    sc.sticky[step_key] = total_steps
    sc.sticky[done_key] = done_flag

    # outputs
    AgentsOut = agents
    AgentPts = [ag.pos for ag in agents]
    active_count = sum(1 for a in agents if getattr(a, "is_active", True))
    Done = done_flag

    if done_flag:
        Dbg = "DONE ✅ | Total steps: {} | All agents satisfied spacing ≥ {}.".format(
            total_steps, MinSpacing)
    elif total_steps >= MaxSteps:
        Dbg = "STOP (MaxSteps) ⚠ | Total steps: {} / {} | Active agents: {}".format(
            total_steps, MaxSteps, active_count)
    else:
        Dbg = "Running… | Total steps: {} / {} | Active agents: {} | MinSpacing: {} | HomeWeight: {} | SlopeInf: {} | SlopeMode: {}".format(
            total_steps, MaxSteps, active_count, MinSpacing, HomeWeight, SlopeInf, SlopeMode)
# ---------- end py3_3 ----------
panel = Panel(py3_3.Dbg)
dam = DataDam(DataA=py3_3.AgentPts, BufferDelay=10000000, BufferMode=0)
py3_4 = Python3Script(Srf=py3.a, AgentPts=dam)  # -> out, a; inputs Srf: Surface, AgentPts: list of Point3d
# ---------- py3_4: Python ----------
import Rhino.Geometry as rg
import math

EPS = 1e-9

# ------------------------------------------------------------
# Inputs (from Grasshopper):
#   Srf       : surface or brep
#   AgentPts  : list of points
# Outputs:
#   a : Voronoi cell curves on surface
#   b : cell center points
# ------------------------------------------------------------

CellCrvs = []
Centers  = []

# ------------------------------------------------------------
# GUARD: if no data, just output empty lists
# ------------------------------------------------------------
if Srf is None or AgentPts is None or len(AgentPts) == 0:
    a = []
    b = []
else:
    # --------------------------------------------------------
    # 1) Get a single surface face to work with
    # --------------------------------------------------------
    if isinstance(Srf, rg.Brep):
        face = Srf.Faces[0]
    else:
        face = Srf

    # UV domain of the surface
    du = face.Domain(0)
    dv = face.Domain(1)
    u0, u1 = du.T0, du.T1
    v0, v1 = dv.T0, dv.T1

    # --------------------------------------------------------
    # 2) Map AgentPts to UV (parameter space)
    # --------------------------------------------------------
    sites = []
    for p in AgentPts:
        ok, u, v = face.ClosestPoint(p)
        if ok:
            sites.append((u, v))

    # If fewer than 2 sites, no Voronoi
    if len(sites) < 2:
        a = []
        b = []
    else:
        # ----------------------------------------------------
        # 3) Voronoi helper functions (same as your example)
        # ----------------------------------------------------
        def perp_bisector(a, b):
            ax, ay = a
            bx, by = b
            if abs(ax - bx) < EPS and abs(ay - by) < EPS:
                return None
            mx = (ax + bx) / 2.0
            my = (ay + by) / 2.0
            dx = bx - ax
            dy = by - ay
            L = math.hypot(dx, dy)
            if L < EPS:
                return None
            A = dx / L
            B = dy / L
            C = -(A * mx + B * my)
            return A, B, C

        def same_side(pt, A, B, C, ref):
            x, y = pt
            rx, ry = ref
            s1 = A * x + B * y + C
            s2 = A * rx + B * ry + C
            if abs(s1) < EPS:
                return True
            return (s1 >= 0) == (s2 >= 0)

        def intersect(A, B, C, p1, p2):
            x1, y1 = p1
            x2, y2 = p2
            dx = x2 - x1
            dy = y2 - y1
            denom = A * dx + B * dy
            if abs(denom) < EPS:
                return None
            t = -(A * x1 + B * y1 + C) / denom
            if 0 <= t <= 1:
                return (x1 + t * dx, y1 + t * dy)
            return None

        def clip(poly, A, B, C, ref):
            out = []
            m = len(poly)
            for i in range(m):
                P = poly[i]
                Q = poly[(i + 1) % m]
                Pin = same_side(P, A, B, C, ref)
                Qin = same_side(Q, A, B, C, ref)

                if Pin and Qin:
                    out.append(Q)
                elif Pin and not Qin:
                    ip = intersect(A, B, C, P, Q)
                    if ip:
                        out.append(ip)
                elif not Pin and Qin:
                    ip = intersect(A, B, C, P, Q)
                    if ip:
                        out.append(ip)
                    out.append(Q)
            return out

        # ----------------------------------------------------
        # 4) Build initial UV-domain box & compute cells
        # ----------------------------------------------------
        uv_box = [(u0, v1), (u1, v1), (u1, v0), (u0, v0)]
        cells = []

        for i, s in enumerate(sites):
            cell = list(uv_box)
            for j, o in enumerate(sites):
                if i == j:
                    continue
                bis = perp_bisector(s, o)
                if bis is None:
                    continue
                A, B, C = bis
                cell = clip(cell, A, B, C, s)
                if not cell:
                    break
            cells.append(cell)

        # ----------------------------------------------------
        # 5) Convert each UV cell to 3D curve on surface
        #    + compute a simple center point
        # ----------------------------------------------------
        for poly in cells:
            if len(poly) < 3:
                continue

            # UV -> 3D
            pts3 = [face.PointAt(u, v) for (u, v) in poly]
            crv = rg.Polyline(pts3 + [pts3[0]]).ToNurbsCurve()
            CellCrvs.append(crv)

            # center = average of vertices
            cx = sum(p.X for p in pts3) / len(pts3)
            cy = sum(p.Y for p in pts3) / len(pts3)
            cz = sum(p.Z for p in pts3) / len(pts3)
            Centers.append(rg.Point3d(cx, cy, cz))

        # ----------------------------------------------------
        # 6) Assign to Grasshopper outputs
        # ----------------------------------------------------
        a = CellCrvs
        b = Centers
# ---------- end py3_4 ----------

# ---- group: variation 2
crv_2 = Curve([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])

# ---- group: variation 1
crv_3 = Curve([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])

# ---- group: variation 3
crv_4 = Curve([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])
